# Dynamo graph lesson_01.dyn (Dynamo 2.5.0.7460)

# group: Lesson 1
integer_slider = IntegerSlider(8, range=0..100 step 2)
number_slider = DoubleSlider(10, range=0..100 step 0.1)
byCoordinates = Point.ByCoordinates(x=number_slider, y=number_slider, z=number_slider)
integer_slider_2 = IntegerSlider(0, range=0..100 step 1)
byCoordinates_2 = Point.ByCoordinates(x=integer_slider_2, y=integer_slider_2, z=integer_slider_2)
byStartPointEndPoint = Line.ByStartPointEndPoint(startPoint=byCoordinates, endPoint=byCoordinates_2)

# group: Lesson 2
integer_slider_3 = IntegerSlider(22, range=0..100 step 2)
# note: Design Script language
code_block = CodeBlock(x2=integer_slider_3, y2=integer_slider_3) { p1 = Point.ByCoordinates(0,0,0); p2 = Point.ByCoordinates(x2,y2,0); myLine = Line.ByStartPointEndPoint(p1, p2); }
range = Range()
byCoordinates_3 = Point.ByCoordinates(x=range)
# note: Sintaxe do Range no Code Block
code_block_2 = CodeBlock { 0..10..1; }
code_block_3 = CodeBlock { 0; 10; 1; }
code_block_4 = CodeBlock(startNum=code_block_3.out0, endNum=code_block_3.out1, stepValue=code_block_3.out2) { startNum..endNum..stepValue; }
code_block_5 = CodeBlock { 0; 10; 5; }
code_block_6 = CodeBlock(startNumber=code_block_5.out0, endNumber=code_block_5.out1, numberOfNumers=code_block_5.out2) { startNumber..endNumber..#numberOfNumers; }
code_block_7 = CodeBlock { 0; 360; 1; }
code_block_8 = CodeBlock(start=code_block_7.out0, end=code_block_7.out1, step=code_block_7.out2) { start..end..step; }
sin = Math.Sin(angle=code_block_8)
code_block_9 = CodeBlock { 20; }
mul = sin * code_block_9
byCoordinates_4 = Point.ByCoordinates(x=code_block_8, y=mul)

# group: Lesson 3
integer_slider_4 = IntegerSlider(22, range=0..100 step 2)
# note: Create custon node
lineByPoint = Custom[LineByPoint](x2=integer_slider_4)  # Creates a line from two points.

code_block_10 = CodeBlock { 0..10; }
byCoordinates_5 = Point.ByCoordinates(x=code_block_10)
code_block_11 = CodeBlock { 0..5; 2; }
byCoordinates_6 = Point.ByCoordinates(x=code_block_11.out0, z=code_block_11.out1)
# note: Lacing:
# Auto
# Shortest
# Longest
# Cross product
byStartPointEndPoint_2 = Line.ByStartPointEndPoint(startPoint=byCoordinates_5, endPoint=byCoordinates_6, lacing=Shortest)
